# Grasshopper definition SJB Updater.gh (Grasshopper 1.0.8)

# ---- group: 1. Set to True
toggle = BooleanToggle(True)

# ----
python = GhPythonScript(run=toggle)  # -> out
# ---------- python: Python ----------
# This script was copied from the Ladybug Tools installation script

import os
import System.Net
import zipfile
import shutil
        
from Grasshopper.Kernel import GH_RuntimeMessageLevel as Message
        
def nukedir(target_dir, rmdir=False):

    d = os.path.normpath(target_dir)
    if not os.path.isdir(d):
        return

    files = os.listdir(d)
    for f in files:
        if f == '.' or f == '..':
            continue
        path = os.path.join(d, f)
        if os.path.isdir(path):
            nukedir(path)
        else:
            try:
                os.remove(path)
            except Exception:
                print("Failed to remove %s" % path)
                
                
def download_file_by_name(url, target_folder, file_name):

    # create the target file path.
    file_path = os.path.join(target_folder, file_name)
        
    # set the security protocol to the most recent version
    try:
        # TLS 1.2 is needed to download over https
        System.Net.ServicePointManager.SecurityProtocol = \
            System.Net.SecurityProtocolType.Tls12
    except AttributeError:
        # TLS 1.2 is not provided by MacOS .NET in Rhino 5
        if url.lower().startswith('https'):
            print ('This system lacks the necessary security'
                   ' libraries to download over https.')
        
    # attempt to download the file
    client = System.Net.WebClient()
    try:
        client.DownloadFile(url, file_path)
    except Exception as e:
        raise Exception(' Download failed with the error:\n{}'.format(e))
    return file_path
        
        
def unzip_file(source_file, dest_dir=None):

    # set default dest_dir and create it if need be.
    if dest_dir is None:
        dest_dir, fname = os.path.split(source_file)
    # extract files to destination
    with zipfile.ZipFile(source_file) as zf:
        for member in zf.infolist():
            words = member.filename.split('\\')
            for word in words[:-1]:
                drive, word = os.path.splitdrive(word)
                head, word = os.path.split(word)
                if word in (os.curdir, os.pardir, ''):
                    continue
                dest_dir = os.path.join(dest_dir, word)
            zf.extract(member, dest_dir)
        
        
def remove_zip_file(zip_file):
    """Try to remove a zip file."""
    try:
        os.remove(zip_file)
    except:
        print 'Failed to remove downloaded zip file: {}.'.format(zip_file)

win_url = 'https://github.com/SJB-KIT/GH-Toolbar/raw/refs/heads/main/SJB.zip'

default_dir = os.path.expandvars(r'%APPDATA%\Grasshopper\UserObjects')

if _run:    
    try:
        nukedir(default_dir + '\SJB')
        zip_file = download_file_by_name(win_url, default_dir, 'SJB.zip')
        unzip_file(zip_file, default_dir)
        remove_zip_file(zip_file)
        print 'Successfully installed. Restart Rhino'
    except Exception as e:
        raise Exception(' Installation failed with the error:\n{}'.format(e))
else:  # give a message about what to do
    print 'Make sure you are connected to the internet and set _run to True!'
# ---------- end python ----------
panel = Panel(python)
